# Grasshopper definition Method 2 - Automatic Sectioning.gh (Grasshopper 1.0.8)
# plug-ins: RhinoCodePluginGH, Pufferfish, Human

# ---- group: For BREPS
custom_mesh_settings = SettingsCustom(
    StitchSeams=True,
    SimplePlanes=False,
    Refine=True,
    MinCount=Slider(50, range=0..100),
    MaxCount=400,
    AspectRatio=20,
    MaxDistance=0,
    MaxAngle=20,
    MinEdge=0,
    MaxEdge=0)
brep = Brep(<brep referenced from the Rhino model>)
mesh = MeshBrep(Brep=brep, Settings=custom_mesh_settings)

# ----
dir = DirectoryContents(IncludeSubfolders=False)  # -> FilePaths, FileNames
py3 = Python3Script(
    filepath=dir.FilePaths,
    Y_offset=Slider(3, range=0..10),
    Diameter_value=Slider(50, range=0..100),
    W=Slider(0.4, range=0..1))  # -> out, tree_x, tree_y, tree_z, tree_D, tree_x_new, tree_z_new, modified_gcode_path; inputs Y_offset: Double; disabled
# ---------- py3: Python ----------
import re
import math
from Grasshopper import DataTree
from Grasshopper.Kernel.Data import GH_Path

# Initialize output trees
tree_x = DataTree[float]()
tree_y = DataTree[float]()
tree_z = DataTree[float]()
tree_D = DataTree[float]()
tree_z_new = DataTree[float]()
tree_x_new = DataTree[float]()

# Read G-code
with open(filepath, 'r') as f:
    lines = f.readlines()

# Extract metadata
min_x_val = min_y_val = min_z = layer_height = layer_count = None

for line in lines:
    line_lower = line.lower().strip()
    if line_lower.startswith(";minx:"):
        min_x_val = float(line_lower.split(":")[1])
    elif line_lower.startswith(";miny:"):
        min_y_val = float(line_lower.split(":")[1])
    elif line_lower.startswith(";minz:"):
        min_z = float(line_lower.split(":")[1])
    elif "layer height:" in line_lower:
        layer_height = float(line_lower.split("layer height:")[1])
    elif line_lower.startswith(";layer_count:"):
        layer_count = int(line_lower.split(":")[1])

# Check metadata
if None in (min_x_val, min_y_val, min_z, layer_height, layer_count):
    raise Exception("Missing required metadata: MINX, MINY, MINZ, Layer height, or LAYER_COUNT")

# Precompute layer-wise Z, D, Z_new
for i in range(layer_count):
    path = GH_Path(i)
    z_val = min_z + i * layer_height
    d_val = z_val + Diameter_value/2
    z_new = z_val + Diameter_value/2
    tree_z.Add(z_val, path)
    tree_D.Add(d_val, path)
    tree_z_new.Add(z_new, path)

# Modify G-code and populate all trees
modified_lines = []
layer_number = -1
last_b_val = None

for line in lines:
    # Layer tracking
    if ";LAYER:" in line:
        match = re.search(r";LAYER:(\d+)", line)
        if match:
            layer_number = int(match.group(1))

    if "M140" in line:
        line = ";M140 S60 ;Set Bed Temperature\n"
    
    if "G28" in line:
        line = ";G28 ;home\n"

    if "Move to corner" in line:
        line = ";G1 X-10 Y-10 F3000 ;Move to corner\n"

    if "Go to zero offset" in line:
        line = re.sub(r'[Zz][-+]?[0-9]*\.?[0-9]+', f'Z100', line)
    
    if "M190" in line:
        line = "G1 X0 Y0 F3000\n;M190 S60 ;Wait for Bed Temperature\n"

    if ";move z" in line.lower():
        line = re.sub(r'[Zz][-+]?[0-9]*\.?[0-9]+', 'Z250', line)

    # Only modify if in valid layer range
    if 0 <= layer_number < layer_count:
        path = GH_Path(layer_number)
        d_val = tree_D.Branch(path)[0]

        # Match and transform X
        x_match = re.search(r'[Xx]([-+]?[0-9]*\.?[0-9]+)', line)
        if x_match:
            x_val = float(x_match.group(1))
            adj_x = x_val - min_x_val + W/2
            x_new = adj_x * (360 / (math.pi * d_val*2))
            line = re.sub(r'[Xx][-+]?[0-9]*\.?[0-9]+', f'B{x_new:.3f}', line)
            tree_x.Add(adj_x, path)
            tree_x_new.Add(x_new, path)

        # Match and transform Y
        y_match = re.search(r'[Yy]([-+]?[0-9]*\.?[0-9]+)', line)
        if y_match:
            y_val = float(y_match.group(1))
            y_new = (y_val - min_y_val) + Y_offset
            line = re.sub(r'[Yy][-+]?[0-9]*\.?[0-9]+', f'Y{y_new:.3f}', line)
            tree_y.Add(y_new, path)

        # Match and transform Z
        z_match = re.search(r'[Zz]([-+]?[0-9]*\.?[0-9]+)', line)
        if z_match:
            z_val = float(z_match.group(1))
            z_new = z_val + Diameter_value/2
            line = re.sub(r'[Zz][-+]?[0-9]*\.?[0-9]+', f'Z{z_new:.3f}', line)
    
        #=== B Discontinuity Correction ===
        b_match = re.search(r"[Bb]([-+]?[0-9]*\.?[0-9]+)", line)
        has_e = "E" in line or "e" in line

        if b_match:
            b_val = float(b_match.group(1))
            if not has_e and last_b_val is not None:
                diff = b_val - last_b_val
                if diff > 180:
                    b1_new = last_b_val + 360
                    modified_lines.append("G92 B{:.3f}\n".format(b1_new))
                elif diff < -180:
                    b1_new = last_b_val - 360
                    modified_lines.append("G92 B{:.3f}\n".format(b1_new))
            last_b_val = b_val
        
    if ";move Z" in line:
        line = re.sub(r'[Zz][-+]?[0-9]*\.?[0-9]+', 'Z150', line)
    
    if ";move X" in line:
        line = re.sub(r'[Bb][-+]?[0-9]*\.?[0-9]+', 'B0', line)

    if ";so the head" in line:
        line = re.sub(r'[Yy][-+]?[0-9]*\.?[0-9]+', 'Y0', line)

    modified_lines.append(line)

# Save updated G-code
out_path = filepath.replace(".gcode", "_transformed.gcode")
with open(out_path, "w") as f:
    f.writelines(modified_lines)

# Output the new file path
modified_gcode_path = out_path
# ---------- end py3 ----------

# ---- group: For Mesh
mesh_2 = Mesh()
py3_2 = Python3Script(mesh=mesh_2, R=Slider(25, range=0..100))  # -> out, a; inputs mesh: Mesh, R: Double; disabled
# ---------- py3_2: Python ----------
import math
import Rhino.Geometry as rg
import ghpythonlib.components as gh

def get_angle(x, z):
    angle = math.atan2(z, x)
    return angle if angle >= 0 else angle + 2 * math.pi

def polar_flatten(v, R):
    x, y, z = v.X, v.Y, v.Z
    r = math.sqrt(x**2 + z**2)
    theta = get_angle(x, z)
    x_new = theta * r
    y_new = y
    z_new = r - R
    return rg.Point3d(x_new, y_new, z_new), theta

# Step 1: Flatten vertices
flattened_pts = []
angles = []
new_mesh = rg.Mesh()

for i in range(mesh.Vertices.Count):
    v = mesh.Vertices[i]
    pt, theta = polar_flatten(v, R)
    flattened_pts.append(pt)
    angles.append(theta)
    new_mesh.Vertices.Add(pt)

# Step 2: Add faces, skip ones crossing seam
def crosses_seam(face_indices):
    face_angles = [angles[i] for i in face_indices]
    face_angles.sort()
    return face_angles[-1] - face_angles[0] > math.pi

for i in range(mesh.Faces.Count):
    f = mesh.Faces[i]
    idx = [f.A, f.B, f.C] if f.IsTriangle else [f.A, f.B, f.C, f.D]
    if not crosses_seam(idx):
        if f.IsTriangle:
            new_mesh.Faces.AddFace(*idx)
        else:
            new_mesh.Faces.AddFace(*idx)

# Step 3: Recalculate normals
new_mesh.Normals.ComputeNormals()
new_mesh.Compact()

# Step 4: Close the mesh like Grasshopper’s Close Mesh
# Automatically fills all holes
#new_mesh.FillHoles()

a = new_mesh
# ---------- end py3_2 ----------

# ----
clsmsh = CloseMesh(Quadrangulate=True)  # -> Closed, Amount, Openings, R
