# Grasshopper definition Method I - Manual Step Sectioning.gh (Grasshopper 1.0.8)
# plug-ins: RhinoCodePluginGH, Heteroptera, Pufferfish, Human, LunchBox

number_slider = Slider(1, range=0..100)
number_slider_2 = Slider(6, range=0..50)

# ---- group: Mandrel
# Cylinder axis >>>>>
Y = UnitY(Factor=1)
# 2- Mandrel Adjustment
# After repositiong the mesh centre mark to the rhino origin in a way that Y axis is the cylindrical height; make sure that the mandrel radius is same as the mesh inner radius.
# Origin >>>>>
pt = Point(Point(0, 0, 0))
# Printing bed height >>>>>
number_slider_3 = Slider(15.16, range=0..100)
circle = CircleCNR(Center=pt, Normal=Y, Radius=number_slider_3)
Y_2 = UnitY(Factor=Slider(70, range=0..100))
extr = Extrude(Base=circle, Direction=Y_2)

# ----
pt_2 = Point(<point referenced from the Rhino model>)
Y_3 = UnitY(Factor=Slider(28, range=0..200))
X = UnitX(Factor=Slider(92, range=0..200))
range = Range(Domain=Domain(0, 1), Steps=expr("x-1", number_slider))
range_2 = Range(Domain=Domain(0, 1), Steps=expr("x-1", number_slider_2))
move = Move(Geometry=pt_2, Motion=Y_3)  # -> Geometry, Transform
move_2 = Move(Geometry=move.Geometry, Motion=X)  # -> Geometry, Transform
# V
graph = GraphMapper(
    flatten(range),
    x0=0,
    x1=1,
    y0=1,
    y1=6.43,
    container_name="Sine",
    Equation_px=[0.002937264275, 0.5021926165],
    Equation_py=[0, 0.9518131614])
# U
graph_2 = GraphMapper(
    flatten(range_2),
    x0=0,
    x1=1,
    y0=1,
    y1=10.99,
    container_name="Sine",
    Equation_px=[0, 0.6013793945],
    Equation_py=[0, 0.9809933901])
feed_rate1 = Slider(408, range=0..2000)
rec_3pt = Rectangle3Pt(PointA=pt_2, PointB=move.Geometry, PointC=move_2.Geometry)  # -> Rectangle, Length
dom = ConstructDomain(DomainStart=1, DomainEnd=Slider(6.43, range=1..100))
dom_2 = ConstructDomain(DomainStart=1, DomainEnd=Slider(10.99, range=1..100))

# ---- group: Separation Line
# 3- Separation line
# Adjust the separation line of the flattening surfaces here.
rotation_angle = Slider(16, range=0..360)
# 1- Assign the mesh here >>>>>
# Make sure the mesh does not have any non-manifold faces or hidden self-intersective faces.
Y_4 = UnitY(Factor=1)
rot3d = Rotate3D(Geometry=extr, Angle=degrees(rotation_angle), Center=Point(0, 0, 0), Axis=Y_4)  # -> Geometry, Transform

# ----
graphmappercontroller = GraphMapperController(GraphMapper=graph, InputRange=range, OutputRange=dom)
graphmappercontroller_2 = GraphMapperController(GraphMapper=graph_2, InputRange=range_2, OutputRange=dom_2)
multiplication = Multiplication(A=feed_rate1, B=graph_2)
toggle = BooleanToggle(False)
multiplication_2 = Multiplication(A=multiplication, B=graft(graph))  # -> flatten(Result)
subtraction = Subtraction(A=Slider(7621, range=0..10000), B=multiplication_2)
preview = BooleanToggle(False)
roundd = RoundToDecimalPlace(NumberX=multiplication_2, DecimalPlace=0, RoundType=0)  # -> Rounded, Difference
dir = DirectoryContents(FolderPath="C:\Users\msi\Desktop\Chiral\Tubes", Filter="S2ADE_D25L30.gcode", IncludeSubfolders=False)  # -> FilePaths, FileNames
ipy2 = IronPython2Script(filepath=dir.FilePaths, Vel=roundd.Rounded, VelGate=Toggle(False))  # -> out, tree_Z, tree_X, tree_Y, tree_Pts, modified_lines; inputs filepath: String, Pts: tree of Point3d, Vel: list of Double, VelGate: Boolean; disabled
# ---------- ipy2: IronPython ----------
import re
from Grasshopper import DataTree
from Grasshopper.Kernel.Data import GH_Path
import Rhino.Geometry as rg
import ghpythonlib.components as ghc
import os


def Velo(Point,layer_number,Pts):

    Path = GH_Path(layer_number)
    CenterLst = Pts.Branch(Path)
    PointPro = ghc.ClosestPoint(Point,CenterLst)
    index = PointPro[1]

    velocity = Vel[index]

    return(velocity)

# INPUTS
# filepath: path to .gcode
# feedrate_val: your desired F value (float or int)

# OUTPUTS
tree_X = DataTree[float]()
tree_Y = DataTree[float]()
tree_Z = DataTree[float]()
tree_Pts = DataTree[object]()
modified_lines = []  # Optional: Store modified G-code lines

layer_number = -1
capture_enabled = True
capture_velocity = True
path = None
current_Z = None
Point = None

# Read the file
with open(filepath, 'r') as f:
    lines = f.readlines()

i = 0
while i < len(lines):
    line = lines[i].strip()

    # Detect layer and Z
    if ";LAYER_CHANGE" in line:
        layer_number += 1
        path = GH_Path(layer_number)

        if i + 1 < len(lines):
            z_line = lines[i + 1].strip()
            z_match = re.match(r";Z:([-+]?[0-9]*\.?[0-9]+)", z_line)
            if z_match:
                current_Z = float(z_match.group(1))
                tree_Z.Add(current_Z, path)
        i += 1
        continue

    # 2. Check capture conditions
    if ";TYPE:Skirt/Brim" in line:
        capture_enabled = False
    elif "; printing object" in line:
        capture_enabled = True
    elif ";TYPE:Internal infill" in line:
        capture_enabled = True
    elif "; stop printing object" in line:
        capture_enabled = False

    if ";TYPE:Perimeter" in line:
        capture_velocity = False
    if ";TYPE:Internal infill" in line:
        capture_velocity = True
    # Modify and collect G1 lines with extrusion
    if layer_number >= 0 and capture_enabled and line.startswith("G1"):
        if 'E' in line or 'e' in line:
            x_match = re.search(r"[Xx]([-+]?[0-9]*\.?[0-9]+)", line)
            y_match = re.search(r"[Yy]([-+]?[0-9]*\.?[0-9]+)", line)

            if x_match and y_match:
                x_val = float(x_match.group(1))
                y_val = float(y_match.group(1))
                if VelGate and capture_velocity:
                    Point = rg.Point3d(x_val, y_val, current_Z)
                    tree_Pts.Add(Point, path)
                    Velocity = Velo(Point,current_Z,Pts)
                else:
                    Velocity = 720

            if x_match:
                tree_X.Add(float(x_match.group(1)), path)
            if y_match:
                tree_Y.Add(float(y_match.group(1)), path)

            # Append F value if not already there
            if "F" not in line and "f" not in line:
                line += " F{}".format(int(Velocity))
            modified_lines.append(line)
        else:
            modified_lines.append(line)
    else:
        modified_lines.append(line)

    i += 1

# Get the folder of the input file
folder_path = os.path.dirname(filepath)

# Create output file path
output_path = os.path.join(folder_path, "modified_output.gcode")

# Write modified lines
with open(output_path, "w") as f_out:
    for l in modified_lines:
        f_out.write(l + "\n")
# ---------- end ipy2 ----------
boundary = BoundarySurfaces(Edges=rec_3pt.Rectangle)
extremes = MinMax(Number=roundd.Rounded)  # -> Minimum, Maximum
quads = QuadPanels(Surface=boundary, UDivisions=number_slider, VDivisions=number_slider_2)
pt_3 = ConstructPoint(XCoordinate=ipy2.tree_X, YCoordinate=ipy2.tree_Y, ZCoordinate=ipy2.tree_Z)
data = Data(ipy2.tree_Pts)
gradient = Gradient(
    LowerLimit=extremes.Minimum,
    UpperLimit=extremes.Maximum,
    Parameter=roundd.Rounded,
    stops=[0: RGB(0, 0, 255), 1: RGB(0, 255, 0)])
series = Series(Start=Slider(1, range=0..1), Step=Slider(0.013, range=0..1), Count=Slider(5, range=0..20))  # -> graft(Series)
bang = ExplodeTree(Data=pt_3)  # -> Branch0, Branch1, Branch2, Branch3, Branch4, Branch5
scale_nu = ScaleNU(Geometry=quads, Plane=pt_2, ScaleX=series, ScaleY=1, ScaleZ=1)  # -> simplify(Geometry), Transform
data_2 = Data(bang.Branch0)
area = Area(Geometry=scale_nu.Geometry)  # -> Area, Centroid

# ----
# 10- Upload the generated gcode from CURA slicer here and get the rotary gcode as output on the same folder
number_slider_4 = Slider(0, range=0..10)
number_slider_5 = Slider(28.9, range=0..100)
number_slider_6 = Slider(0.4, range=0..1)
dir_2 = DirectoryContents(FolderPath="C:\Users\msi\Desktop\Chiral\Tubes", Filter="S2ADE_D28.9.gcode", IncludeSubfolders=False)  # -> FilePaths, FileNames
py3 = Python3Script(
    filepath=dir_2.FilePaths,
    Y_offset=number_slider_4,
    Diameter_value=number_slider_5,
    W=number_slider_6,
    Pts=area.Centroid,
    Vel=roundd.Rounded,
    VelGate=toggle)  # -> out, tree_x, tree_y, tree_z, tree_D, tree_x_new, tree_z_new, modified_gcode_path; inputs Y_offset: Double, Pts: tree of Point3d, Vel: list, VelGate: Boolean; disabled
# ---------- py3: Python ----------
import re
import math
from Grasshopper import DataTree
from Grasshopper.Kernel.Data import GH_Path
import Rhino.Geometry as rg
import ghpythonlib.components as ghc

capture_velocity = False

def Velo(Point,layer_number,Pts):

    Path = GH_Path(layer_number)
    CenterLst = Pts.Branch(Path)
    PointPro = ghc.ClosestPoint(Point,CenterLst)
    index = PointPro[1]

    velocity = Vel[index]

    return(velocity)


# Initialize output trees
tree_x = DataTree[float]()
tree_y = DataTree[float]()
tree_z = DataTree[float]()
tree_D = DataTree[float]()
tree_z_new = DataTree[float]()
tree_x_new = DataTree[float]()

# Read G-code
with open(filepath, 'r') as f:
    lines = f.readlines()

# Extract metadata
min_x_val = min_y_val = min_z = layer_height = layer_count = None

for line in lines:
    line_lower = line.lower().strip()
    if line_lower.startswith(";minx:"):
        min_x_val = float(line_lower.split(":")[1])
    elif line_lower.startswith(";miny:"):
        min_y_val = float(line_lower.split(":")[1])
    elif line_lower.startswith(";minz:"):
        min_z = float(line_lower.split(":")[1])
    elif "layer height:" in line_lower:
        layer_height = float(line_lower.split("layer height:")[1])
    elif line_lower.startswith(";layer_count:"):
        layer_count = int(line_lower.split(":")[1])

# Check metadata
if None in (min_x_val, min_y_val, min_z, layer_height, layer_count):
    raise Exception("Missing required metadata: MINX, MINY, MINZ, Layer height, or LAYER_COUNT")

# Precompute layer-wise Z, D, Z_new
for i in range(layer_count):
    path = GH_Path(i)
    z_val = min_z + i * layer_height
    d_val = z_val + Diameter_value/2
    z_new = z_val + Diameter_value/2
    tree_z.Add(z_val, path)
    tree_D.Add(d_val, path)
    tree_z_new.Add(z_new, path)

# Modify G-code and populate all trees
modified_lines = []
layer_number = -1

for line in lines:
    # Layer tracking
    if ";LAYER:" in line:
        match = re.search(r";LAYER:(\d+)", line)
        if match:
            layer_number = int(match.group(1))

    if "M140" in line:
        line = ";M140 S60 ;Set Bed Temperature\n"
    
    if "G28" in line:
        line = ";G28 ;home\n"

    if "Move to corner" in line:
        line = ";G1 X-10 Y-10 F3000 ;Move to corner\n"

    if "Go to zero offset" in line:
        line = re.sub(r'[Zz][-+]?[0-9]*\.?[0-9]+', f'Z100', line)
    
    if "M190" in line:
        line = "G1 X0 Y0 F3000\n;M190 S60 ;Wait for Bed Temperature\n"

    if ";move z" in line.lower():
        line = re.sub(r'[Zz][-+]?[0-9]*\.?[0-9]+', 'Z250', line)

    if ";LAYER:" in line:
        capture_velocity = True

    if ";TIME_ELAPSED:" in line:
        capture_velocity = False

    # Only modify if in valid layer range
    if 0 <= layer_number < layer_count:
        path = GH_Path(layer_number)
        d_val = tree_D.Branch(path)[0]

        # Match and transform X
        x_match = re.search(r'[Xx]([-+]?[0-9]*\.?[0-9]+)', line)
        if x_match:
            x_val = float(x_match.group(1))
            adj_x = x_val - min_x_val + W/2
            x_new = adj_x * (360 / (math.pi * d_val*2))
            line = re.sub(r'[Xx][-+]?[0-9]*\.?[0-9]+', f'B{x_new:.3f}', line)
            tree_x.Add(adj_x, path)
            tree_x_new.Add(x_new, path)

        # Match and transform Y
        y_match = re.search(r'[Yy]([-+]?[0-9]*\.?[0-9]+)', line)
        if y_match:
            y_val = float(y_match.group(1))
            y_new = (y_val - min_y_val) + Y_offset
            line = re.sub(r'[Yy][-+]?[0-9]*\.?[0-9]+', f'Y{y_new:.3f}', line)
            tree_y.Add(y_new, path)

        f_match = re.search(r'[Ff]([-+]?[0-9]*\.?[0-9]+)', line)
        if f_match and x_match and y_match:
            if 'E' in line or 'e' in line:
                if VelGate and capture_velocity:
                    Point = rg.Point3d(adj_x, y_new, 0)
                    print(type(Point))
                    Velocity = Velo(Point,layer_number,Pts)
                    #line = re.sub(r'[Ff][-+]?[0-9]*\.?[0-9]+', f'F{Velocity:.3f}', line)
        
        # Match and transform Z
        z_match = re.search(r'[Zz]([-+]?[0-9]*\.?[0-9]+)', line)
        if z_match:
            z_val = float(z_match.group(1))
            z_new = z_val + Diameter_value/2
            line = re.sub(r'[Zz][-+]?[0-9]*\.?[0-9]+', f'Z{z_new:.3f}', line)
            
            
    if ";move Z" in line:
        line = re.sub(r'[Zz][-+]?[0-9]*\.?[0-9]+', 'Z150', line)
    
    if ";move X" in line:
        line = re.sub(r'[Bb][-+]?[0-9]*\.?[0-9]+', 'B0', line)

    if ";so the head" in line:
        line = re.sub(r'[Yy][-+]?[0-9]*\.?[0-9]+', 'Y0', line)

    modified_lines.append(line)

# Save updated G-code
out_path = filepath.replace(".gcode", "_transformed.gcode")
with open(out_path, "w") as f:
    f.writelines(modified_lines)

# Output the new file path
modified_gcode_path = out_path
# ---------- end py3 ----------
ipy2_2 = IronPython2Script(
    filepath=dir_2.FilePaths,
    Y_offset=number_slider_4,
    Diameter_value=number_slider_5,
    W=number_slider_6,
    Pts=area.Centroid,
    Vel=roundd.Rounded,
    VelGate=toggle)  # -> out, tree_x, tree_y, tree_z, tree_D, tree_x_new, tree_z_new, modified_gcode_path; inputs Y_offset: Double, Pts: tree of Point3d, Vel: list, VelGate: Boolean; disabled
# ---------- ipy2_2: IronPython ----------
import re
import math
from Grasshopper import DataTree
from Grasshopper.Kernel.Data import GH_Path
import Rhino.Geometry as rg

# --- INPUT PARAMETERS (connect these in Grasshopper) ---
# filepath: str (path to the G-code file)
# W: float (width adjustment)
# Y_offset: float (offset to add to Y)
# Diameter_value: float (used for cylindrical transformation)
# VelGate: bool (whether to apply velocity from Pts/Vel)
# Pts: DataTree[Point3d] (points used for velocity lookup)
# Vel: list of float (velocity values)

# --- OUTPUTS ---
# modified_gcode_path: str (new file path)
# tree_x, tree_y, tree_z: adjusted coordinate trees
# tree_D, tree_z_new, tree_x_new: transformed values

# Initialize trees
capture_velocity = False
layer_number = -1

modified_lines = []
tree_x = DataTree[float]()
tree_y = DataTree[float]()
tree_z = DataTree[float]()
tree_D = DataTree[float]()
tree_z_new = DataTree[float]()
tree_x_new = DataTree[float]()

# Read file
with open(filepath, 'r') as f:
    lines = f.readlines()

# Metadata placeholders
min_x_val = min_y_val = min_z = layer_height = layer_count = None

# Parse header metadata
for line in lines:
    line_lower = line.lower().strip()
    if line_lower.startswith(";minx:"):
        min_x_val = float(line_lower.split(":")[1])
    elif line_lower.startswith(";miny:"):
        min_y_val = float(line_lower.split(":")[1])
    elif line_lower.startswith(";minz:"):
        min_z = float(line_lower.split(":")[1])
    elif "layer height:" in line_lower:
        layer_height = float(line_lower.split("layer height:")[1])
    elif line_lower.startswith(";layer_count:"):
        layer_count = int(line_lower.split(":")[1])

if None in (min_x_val, min_y_val, min_z, layer_height, layer_count):
    raise Exception("Missing required metadata: MINX, MINY, MINZ, Layer height, or LAYER_COUNT")

# Precompute D and Z values
for i in range(layer_count):
    path = GH_Path(i)
    z_val = min_z + i * layer_height
    d_val = z_val + Diameter_value / 2
    z_new = z_val + Diameter_value / 2
    tree_z.Add(z_val, path)
    tree_D.Add(d_val, path)
    tree_z_new.Add(z_new, path)

# Helper: velocity lookup
def Velo(point, layer_number, Pts):
    path = GH_Path(layer_number)
    if not Pts.PathExists(path):
        return 0
    center_list = list(Pts.Branch(path))
    if len(center_list) == 0:
        return 0
    import ghpythonlib.components as ghc
    result = ghc.ClosestPoint(point, center_list)
    index = result[1]
    return Vel[index]

# Process lines
for line in lines:
    if ";LAYER:" in line:
        match = re.search(r";LAYER:(\d+)", line)
        if match:
            layer_number = int(match.group(1))

    if ";LAYER:" in line:
        capture_velocity = True
    if ";TIME_ELAPSED:" in line:
        capture_velocity = False

    # Preprocess special M commands
    if "M140" in line:
        line = ";M140 S60 ;Set Bed Temperature\n"
    if "G28" in line:
        line = ";G28 ;home\n"
    if "Move to corner" in line:
        line = ";G1 X-10 Y-10 F3000 ;Move to corner\n"
    if "Go to zero offset" in line:
        line = re.sub(r"[Zz][-+]?[0-9]*\.?[0-9]+", "Z100", line)
    if ";move z" in line.lower():
        line = re.sub(r"[Zz][-+]?[0-9]*\.?[0-9]+", "Z250", line)
    if ";move Z" in line:
        line = re.sub(r"[Zz][-+]?[0-9]*\.?[0-9]+", "Z150", line)
    if ";move X" in line:
        line = re.sub(r"[Bb][-+]?[0-9]*\.?[0-9]+", "B0", line)
    if ";so the head" in line:
        line = re.sub(r"[Yy][-+]?[0-9]*\.?[0-9]+", "Y0", line)
    if "M190" in line:
        line = "G1 X0 Y0 F3000\n;M190 S60 ;Wait for Bed Temperature\n"

    if 0 <= layer_number < layer_count:
        path = GH_Path(layer_number)
        d_val = tree_D.Branch(path)[0]

        x_match = re.search(r"[Xx]([-+]?[0-9]*\.?[0-9]+)", line)
        if x_match:
            x_val = float(x_match.group(1))
            adj_x = x_val - min_x_val + W / 2
            x_new = adj_x * (360 / (math.pi * d_val * 2))
            line = re.sub(r"[Xx][-+]?[0-9]*\.?[0-9]+", "B{:.3f}".format(x_new), line)
            tree_x.Add(adj_x, path)
            tree_x_new.Add(x_new, path)

        y_match = re.search(r"[Yy]([-+]?[0-9]*\.?[0-9]+)", line)
        if y_match:
            y_val = float(y_match.group(1))
            y_new = (y_val - min_y_val) + Y_offset
            line = re.sub(r"[Yy][-+]?[0-9]*\.?[0-9]+", "Y{:.3f}".format(y_new), line)
            tree_y.Add(y_new, path)

        z_match = re.search(r"[Zz]([-+]?[0-9]*\.?[0-9]+)", line)
        if z_match:
            z_val = float(z_match.group(1))
            z_new = z_val + Diameter_value / 2
            line = re.sub(r"[Zz][-+]?[0-9]*\.?[0-9]+", "Z{:.3f}".format(z_new), line)

        f_match = re.search(r"[Ff]([-+]?[0-9]*\.?[0-9]+)", line)
        if f_match and x_match and y_match and ('E' in line or 'e' in line):
            if VelGate and capture_velocity:
                pt = rg.Point3d(adj_x, y_new, 0)
                vel = Velo(pt, layer_number, Pts)
                line = re.sub(r"[Ff][-+]?[0-9]*\.?[0-9]+", "F{:.3f}".format(vel), line)

    modified_lines.append(line)

# Save new G-code
out_path = filepath.replace(".gcode", "_transformed.gcode")
with open(out_path, "w") as f:
    for l in modified_lines:
        f.write(l)

modified_gcode_path = out_path
# ---------- end ipy2_2 ----------

ipy2_3 = IronPython2Script(
    filepath=dir_2.FilePaths,
    Y_offset=number_slider_4,
    Diameter_value=number_slider_5,
    W=number_slider_6,
    Pts=area.Centroid,
    Vel=roundd.Rounded,
    VelGate=toggle)  # -> out, tree_x, tree_y, tree_z, tree_D, tree_x_new, tree_z_new, modified_gcode_path; inputs Y_offset: Double, Pts: tree of Point3d, Vel: list, VelGate: Boolean
# ---------- ipy2_3: IronPython ----------
import re
import math
from Grasshopper import DataTree
from Grasshopper.Kernel.Data import GH_Path
import Rhino.Geometry as rg
import ghpythonlib.components as ghc

# INPUTS:
# filepath (str), Diameter_value (float), W (float), Y_offset (float),
# VelGate (bool), Pts (DataTree[Point3d]), Vel (list[float])

# OUTPUT:
# modified_gcode_path (str)

tree_x = DataTree[float]()
tree_y = DataTree[float]()
tree_z = DataTree[float]()
tree_D = DataTree[float]()
tree_z_new = DataTree[float]()
tree_x_new = DataTree[float]()

def Velo(point, layer_number, Pts):
    path = GH_Path(layer_number)
    if not Pts.PathExists(path):
        return 0
    center_list = list(Pts.Branch(path))
    if len(center_list) == 0:
        return 0
    result = ghc.ClosestPoint(point, center_list)
    index = result[1]
    return Vel[index]

with open(filepath, 'r') as f:
    lines = f.readlines()

# Parse metadata
min_x_val = min_y_val = min_z = layer_height = layer_count = None
for line in lines:
    line_lower = line.lower().strip()
    if line_lower.startswith(";minx:"):
        min_x_val = float(line_lower.split(":")[1])
    elif line_lower.startswith(";miny:"):
        min_y_val = float(line_lower.split(":")[1])
    elif line_lower.startswith(";minz:"):
        min_z = float(line_lower.split(":")[1])
    elif "layer height:" in line_lower:
        layer_height = float(line_lower.split("layer height:")[1])
    elif line_lower.startswith(";layer_count:"):
        layer_count = int(line_lower.split(":")[1])

if None in (min_x_val, min_y_val, min_z, layer_height, layer_count):
    raise Exception("Missing required metadata: MINX, MINY, MINZ, Layer height, or LAYER_COUNT")

for i in range(layer_count):
    path = GH_Path(i)
    z_val = min_z + i * layer_height
    d_val = z_val + Diameter_value / 2
    z_new = z_val + Diameter_value / 2
    tree_z.Add(z_val, path)
    tree_D.Add(d_val, path)
    tree_z_new.Add(z_new, path)

modified_lines = []
layer_number = -1
capture_velocity = False
last_b_val = None

for line in lines:
    original_line = line

    if ";LAYER:" in line:
        match = re.search(r";LAYER:(\d+)", line)
        if match:
            layer_number = int(match.group(1))

    if "M140" in line:
        line = ";M140 S60 ;Set Bed Temperature\n"
    if "G28" in line:
        line = ";G28 ;home\n"
    if "Move to corner" in line:
        line = ";G1 X-10 Y-10 F3000 ;Move to corner\n"
    if "Go to zero offset" in line:
        line = re.sub(r"[Zz][-+]?[0-9]*\.?[0-9]+", "Z100", line)
    if "M190" in line:
        line = "G1 X0 Y0 F3000\n;M190 S60 ;Wait for Bed Temperature\n"
    if ";move z" in line.lower():
        line = re.sub(r"[Zz][-+]?[0-9]*\.?[0-9]+", "Z250", line)
    if ";move Z" in line:
        line = re.sub(r"[Zz][-+]?[0-9]*\.?[0-9]+", "Z150", line)
    if ";move X" in line:
        line = re.sub(r"[Bb][-+]?[0-9]*\.?[0-9]+", "B0", line)
    if ";so the head" in line:
        line = re.sub(r"[Yy][-+]?[0-9]*\.?[0-9]+", "Y0", line)

    if ";LAYER:" in line:
        capture_velocity = True
    if ";TIME_ELAPSED:" in line:
        capture_velocity = False

    if 0 <= layer_number < layer_count:
        path = GH_Path(layer_number)
        d_val = tree_D.Branch(path)[0]

        # X to B
        x_match = re.search(r"[Xx]([-+]?[0-9]*\.?[0-9]+)", line)
        if x_match:
            x_val = float(x_match.group(1))
            adj_x = x_val - min_x_val + W / 2
            x_new = adj_x * (360 / (math.pi * d_val * 2))
            line = re.sub(r"[Xx][-+]?[0-9]*\.?[0-9]+", "B{:.3f}".format(x_new), line)
            tree_x.Add(adj_x, path)
            tree_x_new.Add(x_new, path)
        else:
            x_new = None

        # Y
        y_match = re.search(r"[Yy]([-+]?[0-9]*\.?[0-9]+)", line)
        if y_match:
            y_val = float(y_match.group(1))
            y_new = (y_val - min_y_val) + Y_offset
            line = re.sub(r"[Yy][-+]?[0-9]*\.?[0-9]+", "Y{:.3f}".format(y_new), line)
            tree_y.Add(y_new, path)

        # Z
        z_match = re.search(r"[Zz]([-+]?[0-9]*\.?[0-9]+)", line)
        if z_match:
            z_val = float(z_match.group(1))
            z_new = z_val + Diameter_value / 2
            line = re.sub(r"[Zz][-+]?[0-9]*\.?[0-9]+", "Z{:.3f}".format(z_new), line)

        # F Velocity override
        f_match = re.search(r"[Ff]([-+]?[0-9]*\.?[0-9]+)", line)
        if f_match and x_match and y_match:
            if "E" in line or "e" in line:
                if VelGate and capture_velocity:
                    pt = rg.Point3d(adj_x, y_new, 0)
                    vel = Velo(pt, layer_number, Pts)
                    line = re.sub(r"[Ff][-+]?[0-9]*\.?[0-9]+", "F{:.3f}".format(vel), line)

        # === B Discontinuity Correction ===
        b_match = re.search(r"[Bb]([-+]?[0-9]*\.?[0-9]+)", line)
        has_e = "E" in line or "e" in line

        if b_match:
            b_val = float(b_match.group(1))
            if not has_e and last_b_val is not None:
                diff = b_val - last_b_val
                if diff > 180:
                    b1_new = last_b_val + 360
                    modified_lines.append("G92 B{:.3f}\n".format(b1_new))
                elif diff < -180:
                    b1_new = last_b_val - 360
                    modified_lines.append("G92 B{:.3f}\n".format(b1_new))
            last_b_val = b_val

    modified_lines.append(line)

# Save final modified G-code
out_path = filepath.replace(".gcode", "_transformed.gcode")
with open(out_path, "w") as f:
    for l in modified_lines:
        f.write(l)

modified_gcode_path = out_path
# ---------- end ipy2_3 ----------
data_3 = Data(scale_nu.Geometry)
pline = PolyLine(Vertices=data_2, Closed=False)

# ---- group: Inner Section
inner = BooleanToggle(False)
mesh = Mesh(<mesh referenced from the Rhino model>)
filter = StreamFilter(Gate=inner, Stream1=rot3d.Geometry)
offset = OffsetSurface(Surface=filter, Distance=expr("-x", Slider(0.05, range=0..0.05)), Retrim=True)
mmx = MeshMesh(MeshA=offset, MeshB=mesh)
filter_2 = StreamFilter(Gate=preview, Stream1=mmx)
data_4 = Data(filter_2)
flatten = BooleanToggle(False)
cluster = Cluster(G=flatten, surface=offset, mesh=mesh, F=Slider(0, range=0..100))  # -> surface_2, curve

# ----
bang_2 = ExplodeTree(Data=quads)  # -> Branch0, Branch1
bang_3 = ExplodeTree(Data=area.Centroid)  # -> Branch0, Branch1
pt_4 = ConstructPoint(XCoordinate=ipy2_3.tree_x, YCoordinate=ipy2_3.tree_y, ZCoordinate=ipy2_3.tree_z)
pt_5 = ConstructPoint(XCoordinate=ipy2_2.tree_x, YCoordinate=ipy2_2.tree_y, ZCoordinate=ipy2_2.tree_z)
previewmat = CustomPreviewMaterials(Geometry=bang_2.Branch0, DiffuseColor=gradient)
screentext = ScreenOrientedText(
    Text=roundd.Rounded,
    Justification=7,
    Location=bang_3.Branch0,
    SizeFactor=Slider(8, range=0..100),
    Depth=0,
    Absolute=False)

# ---- group: Sections Main
# 4- adjust the layers height and number here to include whole shape.
# Toggle this and check in the preview panel to see if you can get the flattened curves >>>>>
_1st_layer_height = Slider(0.2, range=0..1)
offset_2 = OffsetSurface(Surface=rot3d.Geometry, Distance=expr("-x", _1st_layer_height), Retrim=True)
layers_height = Slider(0.195, range=0..1)
number_of_layers = Slider(2, range=0..50)
series_2 = Series(Start=layers_height, Step=layers_height, Count=number_of_layers)
offset_3 = OffsetSurface(Surface=offset_2, Distance=expr("-x", series_2), Retrim=True)
data_5 = Data([offset_2, offset_3])

# ----
data_6 = Data(offset_2)
data_7 = Data(mesh)

# ---- group: Second Section
# 6- Get the second section flattened surface and extruded surface
number_slider_7 = Slider(0, range=0..1)
# 5- Get the second section flattened curves
toggle_2 = BooleanToggle(False)
subtraction_2 = Subtraction(A=_1st_layer_height, B=number_slider_7)
cluster_2 = Cluster(G=toggle_2, surface=data_6, mesh=data_7, F=subtraction_2)  # -> surface_2, curve

# ---- group: First Block of Solid
trim = BooleanToggle(False)
extrude = BooleanToggle(False)
data_8 = Data(cluster.surface_2)
data_9 = Data(cluster.curve)
cluster_3 = Cluster_2(surface=data_8, curve=data_9, G=trim)
area_2 = Area(Geometry=cluster_3)  # -> Area, Centroid
item = ListItem(List=cluster_3, Index=Slider(13, range=0..100), Wrap=True)
sort = SortList(Keys=area_2.Area, ValuesA=cluster_3)  # -> Keys, ValuesA
item_2 = ListItem(List=reverse(sort.ValuesA), Index=0, Wrap=True)
filter_3 = StreamFilter(Gate=extrude, Stream1=item_2)
Z = UnitZ(Factor=subtraction_2)
# Toggle this and check in the preview panel to see if you can get the flattened surface(s) >>>>>
# Toggle this and check in the preview panel to see if you the flattened surface(s) is extruded >>>>>
extr_2 = Extrude(Base=filter_3, Direction=Z)

# ---- group: 2nd Block of Solid
trim_2 = BooleanToggle(False)
extrude_2 = BooleanToggle(False)
data_10 = Data(cluster_2.surface_2)
data_11 = Data(cluster_2.curve)
cluster_4 = Cluster_2(surface=data_10, curve=data_11, G=trim_2)
area_3 = Area(Geometry=cluster_4)  # -> Area, Centroid
item_3 = ListItem(List=cluster_4, Index=Slider(13, range=0..100), Wrap=True)
sort_2 = SortList(Keys=area_3.Area, ValuesA=cluster_4)  # -> Keys, ValuesA
item_4 = ListItem(List=reverse(sort_2.ValuesA), Index=0, Wrap=True)
filter_4 = StreamFilter(Gate=extrude_2, Stream1=item_4)
Z_2 = UnitZ(Factor=_1st_layer_height)
extr_3 = Extrude(Base=filter_4, Direction=expr("-x", Z_2))

# ---- group: Other Sections
subtraction_3 = Subtraction(A=series_2, B=Slider(0, range=0..1))
data_12 = Data(flatten(offset_3))
data_13 = Data(mesh)
addition = Addition(A=subtraction_3, B=_1st_layer_height)
cluster_5 = Cluster_3(G=Toggle(False), surface=data_12, mesh=data_13, T=addition)  # -> surface_2, curve

# ---- group: Middle Sections
division = Division(A=_1st_layer_height, B=2)
# 7- Get other sections flattened curves
division_2 = Division(A=layers_height, B=2)
addition_2 = Addition(A=division, B=division_2)
offset_4 = OffsetSurface(Surface=rot3d.Geometry, Distance=expr("-x/2", _1st_layer_height), Retrim=True)
series_3 = Series(Start=addition_2, Step=layers_height, Count=number_of_layers)
offset_5 = OffsetSurface(Surface=offset_4, Distance=expr("-x", series_3), Retrim=True)

# ---- group: 2nd Block of Solid
trim_3 = BooleanToggle(False)
extrude_3 = BooleanToggle(False)
# 8- Get other sections flattened surfaces and extruded surfaces
data_14 = Data(cluster_5.surface_2)
data_15 = Data(cluster_5.curve)
cluster_6 = Cluster_2(surface=data_14, curve=data_15, G=trim_3)
area_4 = Area(Geometry=cluster_6)  # -> Area, Centroid
item_5 = ListItem(List=cluster_6, Index=Slider(13, range=0..100), Wrap=True)
sort_3 = SortList(Keys=area_4.Area, ValuesA=cluster_6)  # -> Keys, ValuesA
item_6 = ListItem(List=reverse(sort_3.ValuesA), Index=0, Wrap=True)  # -> simplify(Item)
filter_5 = StreamFilter(Gate=extrude_3, Stream1=item_6)
Z_3 = UnitZ(Factor=layers_height)
extr_4 = Extrude(Base=filter_5, Direction=expr("-x", Z_3))

# ---- group: Preview Sections
separation_line = BooleanToggle(False)
inner_section = BooleanToggle(False)
inner_surface = BooleanToggle(False)
_2nd_section = BooleanToggle(False)
_2nd_surface = BooleanToggle(False)
other_sections = BooleanToggle(False)
other_surfaces = BooleanToggle(False)
middle = BooleanToggle(False)
layers = BooleanToggle(False)
# Preview section
mesh_2 = BooleanToggle(False)
filter_6 = StreamFilter(Gate=mesh_2, Stream1=mesh)
filter_7 = StreamFilter(Gate=layers, Stream1=[offset_2, extr, data_5])
filter_8 = StreamFilter(Gate=middle, Stream1=[offset_5, offset_4])
edges = BrepEdges(Brep=rot3d.Geometry)  # -> Naked, Interior, NonManifold
filter_9 = StreamFilter(Gate=inner_surface, Stream1=[item_2, extr_2])
filter_10 = StreamFilter(Gate=_2nd_surface, Stream1=[item_4, extr_3])
filter_11 = StreamFilter(Gate=other_surfaces, Stream1=[item_6, extr_4])
filter_12 = StreamFilter(Gate=separation_line, Stream1=edges.Interior)
filter_13 = StreamFilter(Gate=inner_section, Stream1=cluster.curve)
filter_14 = StreamFilter(Gate=_2nd_section, Stream1=cluster_2.curve)
filter_15 = StreamFilter(Gate=other_sections, Stream1=cluster_5.curve)
preview_2 = CustomPreview(Geometry=filter_6, Material=ColourSwatch(SwatchColor=RGB(61, 104, 235)))
preview_3 = CustomPreview(
    Geometry=filter_8,
    Material={diffuse=RGB(221, 160, 221), emission=RGB(66, 48, 66), shine=0.5, specular=RGB(255, 255, 255), transparency=0})
preview_4 = CustomPreview(Geometry=filter_9, Material=ColourSwatch(SwatchColor=RGB(61, 235, 235)))
preview_5 = CustomPreview(Geometry=filter_10, Material=ColourSwatch(SwatchColor=RGB(61, 235, 235)))
preview_6 = CustomPreview(Geometry=filter_11, Material=ColourSwatch(SwatchColor=RGB(61, 235, 235)))
previewlw = CustomPreviewLineweights(
    Geometry=filter_12,
    Shader={diffuse=RGB(255, 105, 180), emission=RGB(76, 32, 54), shine=0.5, specular=RGB(255, 255, 255), transparency=0},
    Thickness=Slider(20, range=0..50),
    Absolute=False)
previewlw_2 = CustomPreviewLineweights(Geometry=filter_13, Shader=ColourSwatch(SwatchColor=RGB(203, 235, 61)), Thickness=Slider(2, range=0..50), Absolute=False)
previewlw_3 = CustomPreviewLineweights(Geometry=filter_14, Shader=ColourSwatch(SwatchColor=RGB(203, 235, 61)), Thickness=Slider(2, range=0..50), Absolute=False)
previewlw_4 = CustomPreviewLineweights(Geometry=filter_15, Shader=ColourSwatch(SwatchColor=RGB(203, 235, 61)), Thickness=Slider(2, range=0..50), Absolute=False)

# ----
# 9- Bake extruded closed-surfaces and export them as .stl file for CURA or other slicer
bake = Button()
merge = Merge(Data1=extr_4, Data2=extr_3)  # -> flatten(Result)
bake_2 = BakeGeometry(Bake=bake, Geometry=merge, DeleteOldBakes=False, PreserveTrees=False)

# ==== cluster Cluster
surface = ClusterInput()
G = ClusterInput()
mesh = ClusterInput()
F = ClusterInput()
filter = StreamFilter(Gate=G, Stream1=surface)
mmx = MeshMesh(MeshA=filter, MeshB=mesh)
pull = PullCurve(Curve=mmx, Surface=filter)
unroll_brep = UnrollBrep(Brep=filter, Curves=pull)  # -> Brep, Curves, Points
data = Data(unroll_brep.Curves)
rot3d = Rotate3D(Geometry=unroll_brep.Brep, Angle=1.570796327, Center=Point(0, 0, 0), Axis=Vector(0, 0, 1))  # -> Geometry, Transform
rot3d_2 = Rotate3D(Geometry=unroll_brep.Curves, Angle=1.570796327, Center=Point(0, 0, 0), Axis=Vector(0, 0, 1))  # -> Geometry, Transform
dim = Dimensions(Surface=unroll_brep.Brep)  # -> UDimension, VDimension
X = UnitX(Factor=dim.VDimension)
X_2 = UnitX(Factor=dim.VDimension)
move = Move(Geometry=rot3d.Geometry, Motion=X)  # -> Geometry, Transform
move_2 = Move(Geometry=rot3d_2.Geometry, Motion=X_2)  # -> Geometry, Transform
Z = UnitZ(Factor=F)
Z_2 = UnitZ(Factor=F)
move_3 = Move(Geometry=move.Geometry, Motion=Z)  # -> Geometry, Transform
move_4 = Move(Geometry=move_2.Geometry, Motion=Z_2)  # -> Geometry, Transform
surface_2 = ClusterOutput(move_3.Geometry)
join_curves = JoinCurvesPlus(Curves=move_4.Geometry, Tolerance=0.01, Preserve=False)
curve = ClusterOutput(join_curves)

# ==== cluster Cluster_2
surface = ClusterInput()
curve = ClusterInput()
G = ClusterInput()
filter = StreamFilter(Gate=G, Stream1=curve)
srfsplit = SurfaceSplit(Surface=surface, Curves=filter)
trim = ClusterOutput(srfsplit)

# ==== cluster Cluster_3
surface = ClusterInput()
G = ClusterInput()
mesh = ClusterInput()
T = ClusterInput()
filter = StreamFilter(Gate=G, Stream1=surface)
graft = GraftTree(Tree=filter, IncludeEmptyLists=True, IncludeNullItems=True)  # -> simplify(Tree)
mmx = MeshMesh(MeshA=filter, MeshB=mesh)  # -> simplify(Intersections)
pull = PullCurve(Curve=mmx, Surface=graft)
graft_2 = GraftTree(Tree=T, IncludeEmptyLists=True, IncludeNullItems=True)  # -> simplify(Tree)
unroll_brep = UnrollBrep(Brep=graft, Curves=pull)  # -> simplify(Brep), simplify(Curves), Points
rot3d = Rotate3D(Geometry=unroll_brep.Brep, Angle=1.570796327, Center=Point(0, 0, 0), Axis=Vector(0, 0, 1))  # -> Geometry, Transform
rot3d_2 = Rotate3D(Geometry=unroll_brep.Curves, Angle=1.570796327, Center=Point(0, 0, 0), Axis=Vector(0, 0, 1))  # -> Geometry, Transform
dim = Dimensions(Surface=unroll_brep.Brep)  # -> UDimension, VDimension
X = UnitX(Factor=dim.VDimension)
X_2 = UnitX(Factor=dim.VDimension)
move = Move(Geometry=rot3d.Geometry, Motion=X)  # -> Geometry, Transform
move_2 = Move(Geometry=rot3d_2.Geometry, Motion=X_2)  # -> Geometry, Transform
Z = UnitZ(Factor=graft_2)
Z_2 = UnitZ(Factor=graft_2)
move_3 = Move(Geometry=move.Geometry, Motion=Z)  # -> simplify(Geometry), Transform
move_4 = Move(Geometry=move_2.Geometry, Motion=Z_2)  # -> simplify(Geometry), Transform
surface_2 = ClusterOutput(move_3.Geometry)
join_curves = JoinCurvesPlus(Curves=move_4.Geometry, Tolerance=0.01, Preserve=False)  # -> simplify(Curves)
curve = ClusterOutput(join_curves)
